# Grasshopper definition roof-2.gh (Grasshopper 1.0.7)

# ---- group: RH_IN:Z3
z3 = Slider(10, range=1..10)

# ---- group: RH_IN:Z4
z4 = Slider(10, range=1..10)

# ---- group: RH_IN:Z1
z1 = Slider(10, range=1..10)

# ---- group: RH_IN:Z2
z2 = Slider(1, range=1..10)

# ----
pt = ConstructPoint(XCoordinate="10", YCoordinate="10", ZCoordinate=z1)
pt_2 = ConstructPoint(XCoordinate="10", YCoordinate="-10", ZCoordinate=z2)
pt_3 = ConstructPoint(XCoordinate="-10", YCoordinate="-10", ZCoordinate=z3)
pt_4 = ConstructPoint(XCoordinate="-10", YCoordinate="10", ZCoordinate=z4)
ln = Line(StartPoint=pt, EndPoint=pt_2)
ln_2 = Line(StartPoint=pt_2, EndPoint=pt_3)
ln_3 = Line(StartPoint=pt_3, EndPoint=pt_4)
ln_4 = Line(StartPoint=pt, EndPoint=pt_4)
number_slider = Slider(10, range=0..10)
edgesrf = EdgeSurface(CurveA=ln, CurveB=ln_2, CurveC=ln_3, CurveD=ln_4)
divide = DivideDomain²(Domain=edgesrf, UCount=number_slider, VCount=number_slider)
subsrf = Isotrim(Surface=edgesrf, Domain=divide)
area = Area(Geometry=subsrf)  # -> Area, Centroid
project = Project(Geometry=area.Centroid, Plane=PlaneXY(0, 0, 0))  # -> Geometry, Transform
pdecon = Deconstruct(Point=area.Centroid)  # -> XComponent, YComponent, ZComponent
vec2pt = Vector2Pt(PointA=area.Centroid, PointB=project.Geometry, Unitize=False)  # -> Vector, Length
Z = UnitZ(Factor=pdecon.ZComponent)
project_2 = Project(Geometry=subsrf, Plane=Z)  # -> Geometry, Transform
extr = Extrude(Base=project_2.Geometry, Direction=vec2pt.Vector)
mesh = MeshBrep(
    Brep=extr,
    Settings={GridMaxCount=0, GridMinCount=16, JaggedSeams=False, MaxEdgeLength=0, MinEdgeLength=0.0001, MinTolerance=0, Refine=True, RefineAngle=0, RelativeTolerance=0.65, SimplePlanes=True, Tolerance=0})
scale = Scale(Geometry=mesh, Center=project.Geometry, Factor=".8")  # -> Geometry, Transform
rectangle = Rectangle(Plane=PlaneXY(0, 0, 0), XSize="-10 to 10", YSize="-10 to 10", Radius=0)  # -> Rectangle, Length
mjoin = MeshJoin(Meshes=scale.Geometry)
srf = Surface(rectangle.Rectangle)
mesh_2 = MeshBrep(
    Brep=srf,
    Settings={GridMaxCount=0, GridMinCount=16, JaggedSeams=False, MaxEdgeLength=0, MinEdgeLength=0.0001, MinTolerance=0, Refine=True, RefineAngle=0, RelativeTolerance=0.65, SimplePlanes=True, Tolerance=0})  # -> flatten(Mesh)
mjoin_2 = MeshJoin(Meshes=flatten(mjoin))
mesh_3 = Mesh(mjoin_2)

# ---- group: RH_OUT:mesh
data = Data(mesh_3)
