# Grasshopper definition roof-2.gh (Grasshopper 1.0.7)

number_slider = Slider(10, range=1..10)
number_slider_2 = Slider(-10, range=-10..-1)
number_slider_3 = Slider(0, range=0..10)
number_slider_4 = Slider(10, range=1..10)
number_slider_5 = Slider(10, range=1..10)
number_slider_6 = Slider(0, range=0..10)
number_slider_7 = Slider(-10, range=-10..-1)
number_slider_8 = Slider(-10, range=-10..1)
number_slider_9 = Slider(0, range=0..10)
number_slider_10 = Slider(10, range=1..10)
number_slider_11 = Slider(-10, range=-10..-1)
number_slider_12 = Slider(0, range=0..10)
rh_in_count = Slider(82, range=0..100)
panel = Panel("-10 to 0")
random = Random(Range="0 to 10", Number="1", Seed=expr("x+35", rh_in_count))
random_2 = Random(Range="0 to 10", Number="1", Seed=expr("x+3", rh_in_count))
random_3 = Random(Range="0 to 10", Number="1", Seed=expr("x+50", rh_in_count))
random_4 = Random(Range="0 to 10", Number="1", Seed=expr("x+5", rh_in_count))
pt = ConstructPoint(XCoordinate="10", YCoordinate="10", ZCoordinate=random_3)
pt_2 = ConstructPoint(XCoordinate="10", YCoordinate="-10", ZCoordinate=random)
pt_3 = ConstructPoint(XCoordinate="-10", YCoordinate="-10", ZCoordinate=random_2)
pt_4 = ConstructPoint(XCoordinate="-10", YCoordinate="10", ZCoordinate=random_4)
ln = Line(StartPoint=pt, EndPoint=pt_2)
ln_2 = Line(StartPoint=pt_2, EndPoint=pt_3)
ln_3 = Line(StartPoint=pt_3, EndPoint=pt_4)
ln_4 = Line(StartPoint=pt, EndPoint=pt_4)
number_slider_13 = Slider(10, range=0..10)
edgesrf = EdgeSurface(CurveA=ln, CurveB=ln_2, CurveC=ln_3, CurveD=ln_4)
divide = DivideDomain²(Domain=edgesrf, UCount=number_slider_13, VCount=number_slider_13)
subsrf = Isotrim(Surface=edgesrf, Domain=divide)
area = Area(Geometry=subsrf)  # -> Area, Centroid
project = Project(Geometry=area.Centroid, Plane=PlaneXY(0, 0, 0))  # -> Geometry, Transform
pdecon = Deconstruct(Point=area.Centroid)  # -> XComponent, YComponent, ZComponent
vec2pt = Vector2Pt(PointA=area.Centroid, PointB=project.Geometry, Unitize=False)  # -> Vector, Length
Z = UnitZ(Factor=pdecon.ZComponent)
project_2 = Project(Geometry=subsrf, Plane=Z)  # -> Geometry, Transform
extr = Extrude(Base=project_2.Geometry, Direction=vec2pt.Vector)
mesh = MeshBrep(
    Brep=extr,
    Settings={GridMaxCount=0, GridMinCount=16, JaggedSeams=False, MaxEdgeLength=0, MinEdgeLength=0.0001, MinTolerance=0, Refine=True, RefineAngle=0, RelativeTolerance=0.65, SimplePlanes=True, Tolerance=0})
scale = Scale(Geometry=mesh, Center=project.Geometry, Factor=".8")  # -> Geometry, Transform
rectangle = Rectangle(Plane=PlaneXY(0, 0, 0), XSize="-10 to 10", YSize="-10 to 10", Radius=0)  # -> Rectangle, Length
mjoin = MeshJoin(Meshes=scale.Geometry)
srf = Surface(rectangle.Rectangle)
mesh_2 = MeshBrep(
    Brep=srf,
    Settings={GridMaxCount=0, GridMinCount=16, JaggedSeams=False, MaxEdgeLength=0, MinEdgeLength=0.0001, MinTolerance=0, Refine=True, RefineAngle=0, RelativeTolerance=0.65, SimplePlanes=True, Tolerance=0})  # -> flatten(Mesh)
mjoin_2 = MeshJoin(Meshes=flatten(mjoin))
mesh_3 = Mesh(mjoin_2)

# ---- group: RH_OUT:data
data = Data(mesh_3)
